# Grasshopper definition getCroxData.gh (Grasshopper 1.0.7)

number_slider = Slider(5, range=0..10)
number_slider_2 = Slider(10, range=0..10)
pt = ConstructPoint(XCoordinate=number_slider, YCoordinate=number_slider_2, ZCoordinate=0)
expression = Expression(b=number_slider, h=number_slider_2, Expression="b*h^3/12")
expression_2 = Expression(b=number_slider_2, h=number_slider, Expression="b*h^3/12")
rec_2pt = Rectangle2Pt(Plane=PlaneXY(0, 0, 0), PointA=Point(0, 0, 0), PointB=pt, Radius=0)  # -> Rectangle, Length
iy = Panel(expression_2)
ix = Panel(expression)

# ----
# Input geometry of the pixel section
geo = Geometry([<brep referenced from the Rhino model> x3])
explode = Explode(Curve=geo, Recursive=True)  # -> Segments, Vertices
geo_2 = Geometry([<curve referenced from the Rhino model>, <brep referenced from the Rhino model>, <curve referenced from the Rhino model>, <brep referenced from the Rhino model>])
pdecon = Deconstruct(Point=flatten(explode.Vertices))  # -> XComponent, YComponent, ZComponent
amoments = AreaMoments(Geometry=geo)  # -> Area, Centroid, Inertia, InertiaError, Secondary, SecondaryError, Gyration
sort = SortList(Keys=pdecon.ZComponent, ValuesA=flatten(explode.Vertices))  # -> Keys, ValuesA
avr = Average(Input=amoments.Centroid)
pdecon_2 = Deconstruct(Point=avr)  # -> XComponent, YComponent, ZComponent
subtraction = Subtraction(A=pdecon_2.ZComponent, B=Slider(230, range=0..300))
pt_2 = ConstructPoint(XCoordinate=pdecon_2.XComponent, YCoordinate=pdecon_2.YComponent, ZCoordinate=subtraction)
ma = MassAddition(Input=amoments.Area)  # -> Result, PartialResults
pdecon_3 = Deconstruct(Point=amoments.Inertia)  # -> XComponent, YComponent, ZComponent
steel_centroid = Point(pt_2)
item = ListItem(List=sort.ValuesA, Index=0, Wrap=True)
total_area_mm2 = Panel(ma.Result)
dist = Distance(PointA=avr, PointB=amoments.Centroid)
pdecon_4 = Deconstruct(Point=flatten(item))  # -> XComponent, YComponent, ZComponent
sqr = Square(Value=dist)
dist_2 = Distance(PointA=avr, PointB=steel_centroid)
multiplication = Multiplication(A=amoments.Area, B=sqr)
subtraction_2 = Subtraction(A=pdecon_2.ZComponent, B=pdecon_4.ZComponent)
c = Number(dist_2)
addition = Addition(A=multiplication, B=pdecon_3.YComponent)
c_2 = Panel(subtraction_2)
ma_2 = MassAddition(Input=addition)  # -> Result, PartialResults
panel = Panel(ma_2.Result)
c_3 = Panel(c)
